# Grasshopper definition 20161027_a3_XX_fields applications.gh (Grasshopper 0.9.76)
# Copyright: Co-de-iT
# plug-ins: MeshEdit Components, Human

amplifier = Slider(10, range=10..1000)
# File template
# 
# © a3 2016 _ Creative Commons Attribution-NonCommercial-ShareAlike3.0 UnportedLicense.
# 3D field
pt = Point([<point referenced from the Rhino model> x3])

X = UnitX(Factor=1)
Y = UnitY(Factor=1)
merge = Merge(Data1=Slider(0.728, range=0..1.571), Data2=Slider(0.25, range=0..1.571), Data3=Slider(0.25, range=0..1.571))
merge_2 = Merge(Data1=X, Data2=Y, Data3=X)
xy = XYPlane(Origin=pt)
# orientation planes
# for spin forces
rot3d = Rotate3D(Geometry=xy, Angle=merge, Center=pt, Axis=merge_2)  # -> Geometry, Transform

display_density = Slider(80, range=10..500)
grid_size = Slider(80, range=0..100)
pt_2 = Point([<point referenced from the Rhino model> x3])
# custom field
pt_3 = Point(Point(100, 0, 0))
merge_3 = Merge(Data1=Slider(1, range=-1..1), Data2=Slider(-1, range=-1..1), Data3=Slider(-0.873, range=-1..1))
merge_4 = Merge(Data1=Slider(-1, range=-1..1), Data2=Slider(0.486, range=-1..1), Data3=Slider(-0.528, range=-1..1))
merge_5 = Merge(Data1=Slider(8.261, range=1..50), Data2=Slider(23.606, range=1..50), Data3=Slider(17.517, range=1..50))
division = Division(A=grid_size, B=display_density)
multiplication = Multiplication(A=merge_3, B=amplifier)
lng = ListLength(List=pt_2)
pcharge = PointCharge(Point=pt, Charge=multiplication, Decay=2)
# fields are always 3D, here we actually visualize one like that
dots = DotDisplay(Point=pt, Colour=RGB(0, 0, 0), Size=1)
swatch = ColourSwatch(SwatchColor=RGB(255, 255, 255))
sqgrid = Square(Plane=pt_3, Size=division, ExtentX=display_density, ExtentY=display_density)  # -> simplify(graft(Cells)), simplify(graft(Points))
random = Random(Range="0 to 2*Pi", Number=lng, Seed=2)
X_2 = UnitX(Factor=Slider(6.3, range=0..10))
Z = UnitZ(Factor=1)
fspin = SpinForce(Plane=rot3d.Geometry, Strength=merge_4, Radius=merge_5, Decay=2)
vrot = Rotate(Vector=X_2, Axis=Z, Angle=random)
explode = Explode(Curve=sqgrid.Cells, Recursive=True)  # -> Segments, Vertices
vdisex = VectorDisplayEx(Point=pt_2, Vector=vrot, Colour=swatch, Width=2)
dots_2 = DotDisplay(Point=pt_2, Colour=swatch, Size=0.5)
cull_i = CullIndex(List=explode.Vertices, Indices="-1", Wrap=True)

grid_size_2 = Slider(80, range=0..100)
display_density_2 = Slider(30, range=10..50)

points = ValueList({"cell corners": 0, "cell centers": 1}, selected="cell centers")
avr = Average(Input=cull_i)  # -> simplify(ArithmeticMean)
mergef = MergeFields(Fields=[pcharge, fspin])
filter = StreamFilter(Gate=points, Stream0=sqgrid.Points, Stream1=avr)

# ----
# evaluate field
# closest charge
cp = ClosestPoint(Point=filter, Cloud=pt_2)  # -> ClosestPoint, CPIndex, Distance
addition = Addition(A=cp.Distance, B=1)
item = ListItem(List=vrot, Index=cp.CPIndex, Wrap=True)
one_over_x = OneOverX(Value=addition)
multiplication_2 = Multiplication(A=item, B=one_over_x)
unit = UnitVector(Vector=multiplication_2)
vdisex_2 = VectorDisplayEx(Point=filter, Vector=unit, Colour=RGB(0, 0, 0), Width=2)

# ----
# weighted average
cps = ClosestPoints(Point=filter, Cloud=pt_2, Count=lng)  # -> ClosestPoint, CPIndex, Distance
addition_2 = Addition(A=cps.Distance, B=1)
one_over_x_2 = OneOverX(Value=addition_2)
item_2 = ListItem(List=vrot, Index=cps.CPIndex, Wrap=True)
pow = Power(A=one_over_x_2, B=Slider(1.943, range=0..3))
multiplication_3 = Multiplication(A=item_2, B=pow)
avr_2 = Average(Input=multiplication_3)
unit_2 = UnitVector(Vector=avr_2)
vdisex_3 = VectorDisplayEx(Point=filter, Vector=avr_2, Colour=RGB(0, 0, 0), Width=2)

box = DomainBox(Base=PlaneXY(0, 0, 0), X=grid_size_2, Y=grid_size_2, Z=grid_size_2)
# on surface and mesh
toggle = BooleanToggle(True)

directions = Slider(4, range=2..10)
# discrete approximation 3
cir = Circle(Plane=PlaneXY(0, 0, 0), Radius=1)
divide = DivideCurve(Curve=cir, Count=directions, Kinks=False)  # -> Points, Tangents, Parameters
vec = Vector(divide.Points)
cp_2 = ClosestPoint(Point=avr_2, Cloud=vec)  # -> ClosestPoint, CPIndex, Distance
item_3 = ListItem(List=vec, Index=cp_2.CPIndex, Wrap=True)
# unitized output
vdisex_4 = VectorDisplayEx(Point=filter, Vector=item_3, Colour=RGB(0, 0, 0), Width=2)

crv = Curve([<curve referenced from the Rhino model> x5])

Y_2 = UnitY(Factor=1)
# discrete approximation 2
X_3 = UnitX(Factor=1)
rev = Reverse(Vector=X_3)
rev_2 = Reverse(Vector=Y_2)
vec_2 = Vector([Y_2, X_3, rev, rev_2])
cp_3 = ClosestPoint(Point=avr_2, Cloud=vec_2)  # -> ClosestPoint, CPIndex, Distance
item_4 = ListItem(List=vec_2, Index=cp_3.CPIndex, Wrap=True)
# the flexible way: We can transform data into points and then just calculate the distance and find the closest.
# 
# Vectors have the added bonus of being already coded as points so the conversion is immediate.
# 
# In the last example, directions are implemented as points along a circle, but custom directions can be easily implemented as well by sampling the circle at different parameters
# the flexible way -2: For instance, this technique can be also used to map colors in an RGB space to find the closest match in a range
vdisex_5 = VectorDisplayEx(Point=filter, Vector=item_4, Colour=RGB(0, 0, 0), Width=2)

loft_opt = LoftOptions(Closed=toggle, Adjust=False, Rebuild=0, Refit=0, Type=0)
vlen = VectorLength(Vector=avr_2)
exponent = Slider(0.178, range=0..3)
amplifier_2 = Slider(1.216, range=1..10)
loft = Loft(Curves=crv, Options=loft_opt)
# discrete approximation
number_slider = Slider(24, range=2..50)
# NURBS surface from curves
srf = Surface(reparameterize(loft))
pow_2 = Power(A=vlen, B=exponent)
# mesh from curves
mesh_uv = MeshSurface(Surface=loft, UCount=Slider(40, range=2..50), VCount=Slider(29, range=2..50), Overhang=True, Equalize=False)
demesh = DeconstructMesh(Mesh=mesh_uv)  # -> Vertices, Faces, Colours, Normals
sdivide = DivideSurface(Surface=srf, UCount=Slider(25, range=2..50), VCount=number_slider)  # -> Points, Normals, Parameters
bnd = Bounds(Numbers=flatten(pow_2))
flip = FlipMatrix(Data=sdivide.Points)
deface = DeconstructFace(Face=graft(demesh.Faces))  # -> CornerA, CornerB, CornerC, CornerD
dedomain = DeconstructDomain(Domain=bnd)  # -> Start, End

field = Field(mergef)
# evaluate field
evf = EvaluateField(Field=field, Point=flip)  # -> Tensor, Strength

multiplication_4 = Multiplication(A=pow_2, B=amplifier_2)
merge_6 = Merge(Data1=deface.CornerA, Data2=deface.CornerB, Data3=deface.CornerC, Data4=deface.CornerD)
gradient = Gradient(
    LowerLimit=dedomain.Start,
    UpperLimit=dedomain.End,
    Parameter=pow_2,
    stops=[0: RGB(14, 26, 76), 0.346: RGB(237, 249, 255)])

# ----
# discrete approximation 1
X_4 = UnitX(Factor=1)
angle = Angle(VectorA=avr_2, VectorB=X_4)  # -> Angle, Reflex
smaller = SmallerThan(FirstNumber=angle.Angle, SecondNumber="Pi*.75")  # -> SmallerThan, OrEqualTo
larger = LargerThan(FirstNumber=angle.Angle, SecondNumber="Pi*.25")  # -> LargerThan, OrEqualTo
inc = Includes(Value=angle.Angle, Domain="Pi*.25 To Pi*.75")  # -> Includes, Deviation
and = GateAnd(A=smaller.SmallerThan, B=larger.LargerThan)
Y_3 = UnitY(Factor=1)
X_5 = UnitX(Factor=1)
p_n_c = PickNChoose(Pattern=inc.Includes, Stream0=Y_3, Stream1=X_5)
# the "intuitive" way: check angle between vectors and see which is the closest one.
# 
# As you can see, this is fairly easy with a single search domain, but it might get more complicated as the number of discreet values increases (what if I want 6 drections?)
vdisex_6 = VectorDisplayEx(Point=filter, Vector=p_n_c, Colour=ColourSwatch(SwatchColor=RGB(73, 84, 87)), Width=2)

# ----
# directional pattern
crv_2 = Curve(sqgrid.Cells)
explode_2 = Explode(Curve=crv_2, Recursive=True)  # -> Segments, Vertices
# see http://gillesretsin.tumblr.com/image/121055033808
panel = Panel("""true
false""")
not = GateNot(A=panel)
cull = CullPattern(List=explode_2.Segments, CullPattern=not)
cull_2 = CullPattern(List=explode_2.Segments, CullPattern=panel)
weave = Weave(Pattern=inc.Includes, Stream0=cull, Stream1=cull_2, NullGaps=False)
previewlw = CustomPreviewLineweights(Geometry=weave, Shader=ColourSwatch(SwatchColor=RGB(0, 0, 0)), Absolute=False)

amp = Amplitude(Vector=item_3, Amplitude=multiplication_4)

# ----
# face normal
item_5 = ListItem(List=demesh.Normals, Index=merge_6, Wrap=True)
avr_3 = Average(Input=item_5)

# ----
# face center
item_6 = ListItem(List=demesh.Vertices, Index=merge_6, Wrap=True)
avr_4 = Average(Input=item_6)

# ----
# strength-proportional output
vdisex_7 = VectorDisplayEx(Point=filter, Vector=amp, Colour=gradient, Width=2)
bnd_2 = Bounds(Numbers=flatten(evf.Strength))
dom = ConstructDomain(DomainStart=Slider(-2.728, range=-10..10), DomainEnd=Slider(7.2, range=-10..10))
amplifier_3 = Slider(9.435, range=1..100)

field_2 = Field(mergef)
# evaluate field
evf_2 = EvaluateField(Field=field_2, Point=avr_4)  # -> Tensor, Strength

remap = RemapNumbers(Value=evf.Strength, Source=bnd_2, Target=dom)  # -> Mapped, Clipped
Z_2 = UnitZ(Factor=1)
vdisex_8 = VectorDisplayEx(Point=avr_4, Vector=avr_3, Colour=ColourSwatch(SwatchColor=RGB(255, 0, 0)), Width=2)
amp_2 = Amplitude(Vector=Z_2, Amplitude=remap.Mapped)
move = Move(Geometry=flip, Motion=amp_2)  # -> Geometry, Transform
multiplication_5 = Multiplication(A=evf_2.Tensor, B=amplifier_3)
scale = Scale(Geometry=item_6, Center=avr_4, Factor=Slider(0.25, range=0..1))  # -> Geometry, Transform
addition_3 = Addition(A=multiplication_5, B=avr_3)
move_2 = Move(Geometry=scale.Geometry, Motion=addition_3)  # -> Geometry, Transform
srf_cp = SurfaceClosestPoint(Point=move.Geometry, Surface=srf)  # -> Point, UVPoint, Distance
vdisex_9 = VectorDisplayEx(Point=avr_4, Vector=multiplication_5, Colour=ColourSwatch(SwatchColor=RGB(255, 255, 255)), Width=2)
Y_4 = UnitY(Factor="80")
X_6 = UnitX(Factor="40")
mbridge = MeshBridge(Pa=item_6, Pb=move_2.Geometry, S="1")  # -> out, M; inputs Pa: list of Point3d, Pb: list of Point3d, S: Int32, W: Boolean
# ---------- mbridge: C# ----------
    String eol = Environment.NewLine;
    Component.Name = "Mesh Bridge";
    Component.NickName = "MBridge";
    Component.Message = "Mesh Bridge" + eol + "v0.1 _ by Co-de-iT";
    Component.Description = "Builds a Mesh Bridge between lists of points";


    Mesh mesh = new Mesh();
    Mesh mFace = new Mesh();
    if (Pa.Count != Pb.Count) {
      Print("Pa and Pb MUST have the same number of points");
    }else{
      Point3d[][] pts = new Point3d[S + 1][];
      pts[0] = Pa.ToArray();
      pts[S] = Pb.ToArray();
      for (int i = 1; i < S; i++){
        pts[i] = new Point3d[Pa.Count];
        for (int j = 0; j < Pa.Count; j++){
          Vector3d v = Vector3d.Subtract((Vector3d) Pb[j], (Vector3d) Pa[j]);
          v = Vector3d.Divide(v, S);
          pts[i][j] = Point3d.Add(pts[i - 1][j], v);
        }
      }

      for (int i = 0; i < pts.Length - 1; i++){

        for(int j = 0; j < pts[i].Length; j++){
          mFace = new Mesh();
          int ind = (j + 1) % pts[i].Length;
          mFace.Vertices.Add(pts[i][j]);
          mFace.Vertices.Add(pts[i][ind]);
          mFace.Vertices.Add(pts[i + 1][ind]);
          mFace.Vertices.Add(pts[i + 1][j]);
          mFace.Faces.AddFace(0, 1, 2, 3);
          mesh.Append(mFace);
        }

      }
    }
    if(mesh != null && W) mesh.Weld(0.01);
    M = mesh;
# ---------- end mbridge ----------
addition_4 = Addition(A=Y_4, B=X_6)
move_3 = Move(Geometry=srf_cp.Point, Motion=addition_4)  # -> Geometry, Transform
mjoin = MeshJoin(Meshes=flatten(mbridge.M))
weldvertices = MeshWeldVertices(Mesh=mjoin, Tolerance=0.01)  # -> RuntimeMessage, Mesh
loft_opt_2 = LoftOptions(Closed=False, Adjust=False, Rebuild=0, Refit=0, Type=3)
nurbs = NurbsCurve(Vertices=move_3.Geometry, Degree=3, Periodic=Toggle(True))  # -> Curve, Length, Domain
flip_2 = MeshFlip(Mesh=weldvertices.Mesh)
Y_5 = UnitY(Factor="80")
loft_2 = Loft(Curves=flatten(nurbs.Curve), Options=loft_opt_2)
move_4 = Move(Geometry=flip_2, Motion=Y_5)  # -> Geometry, Transform
previewmat = CustomPreviewMaterials(Geometry=move_4.Geometry, DiffuseColor=RGB(255, 255, 255))
previewmat_2 = CustomPreviewMaterials(Geometry=loft_2, DiffuseColor=RGB(255, 255, 255))
previewlw_2 = CustomPreviewLineweights(Geometry=nurbs.Curve, Shader=ColourSwatch(SwatchColor=RGB(0, 0, 0)), Absolute=False)

division_2 = Division(A=grid_size_2, B=display_density_2)
sqgrid_2 = Square(Plane=PlaneXY(0, 0, 0), Size=division_2, ExtentX=display_density_2, ExtentY=display_density_2)  # -> Cells, graft(Points)
explode_3 = Explode(Curve=sqgrid_2.Cells, Recursive=True)  # -> Segments, Vertices
cull_i_2 = CullIndex(List=explode_3.Vertices, Indices="-1", Wrap=True)
points_2 = ValueList({"cell corners": 0, "cell centers": 1}, selected="cell centers")
avr_5 = Average(Input=cull_i_2)  # -> simplify(graft(ArithmeticMean))
dom_2 = ConstructDomain(DomainStart=Slider(0.067, range=0..2), DomainEnd=Slider(1.334, range=0..2))

series = Series(Start=0, Step=division_2, Count=display_density_2)
Z_3 = UnitZ(Factor=series)
move_5 = Move(Geometry=avr_5, Motion=Z_3)  # -> Geometry, Transform

filter_2 = StreamFilter(Gate=points_2, Stream0=sqgrid_2.Points, Stream1=move_5.Geometry)
evf_3 = EvaluateField(Field=mergef, Point=filter_2)  # -> Tensor, Strength
pow_3 = Power(A=evf_3.Strength, B=Slider(0.06, range=0..1))
bnd_3 = Bounds(Numbers=flatten(pow_3))
remap_2 = RemapNumbers(Value=pow_3, Source=bnd_3, Target=dom_2)  # -> Mapped, Clipped
amp_3 = Amplitude(Vector=evf_3.Tensor, Amplitude=remap_2.Mapped)
vdisex_10 = VectorDisplayEx(Point=filter_2, Vector=amp_3, Colour=amp_3, Width=2)

threshold = Slider(0.45, range=0..1)
remap_3 = RemapNumbers(Value=threshold, Source=Domain(0, 1), Target=dom_2)  # -> Mapped, Clipped

# ----
# evaluate a domain with a
# normalized (0..1) value
panel_2 = Panel(remap_3.Mapped)
larger_2 = LargerThan(FirstNumber=remap_2.Mapped, SecondNumber=remap_3.Mapped)  # -> LargerThan, OrEqualTo
amplifier_4 = Slider(5, range=0..10)
dispatch = Dispatch(List=filter_2, DispatchPattern=larger_2.LargerThan)  # -> ListA, ListB
dispatch_2 = Dispatch(List=amp_3, DispatchPattern=larger_2.LargerThan)  # -> ListA, ListB
dispatch_3 = Dispatch(List=remap_2.Mapped, DispatchPattern=larger_2.LargerThan)  # -> ListA, ListB
multiplication_6 = Multiplication(A=dispatch_3.ListA, B=amplifier_4)
pt_4 = Point(dispatch.ListA)
line = LineSDL(Start=dispatch.ListA, Direction=dispatch_2.ListA, Length=multiplication_6)
# filter by threshold
col = Colour(line)
preview = CustomPreview(Geometry=pt_4, Shader=col)
previewlw_3 = CustomPreviewLineweights(Geometry=line, Shader=ColourSwatch(SwatchColor=RGB(120, 120, 120)), Absolute=False)

# ----
# bar graph
# 
# allows to check the value range
# and distribution
bar_graph = BarGraph(remap_2.Mapped, BarColor=RGB(255, 0, 90))
