# Grasshopper definition 20170220_a3XX_Calatrava high-speed.gh (Grasshopper 0.9.76)
# Copyright: Co-de-iT
# plug-ins: Human

# High-Speed Trigonometry Station
# 
# Calatrava "Mediopadana" station in Reggio Emilia as an exercise to learn sine function and sweep 1 rail
# 
# © a3 2016 _ Creative Commons Attribution-NonCommercial-ShareAlike3.0 UnportedLicense.
phase = Slider(1, range=0..1)
series = Series(Start=0, Step=Slider(0.7, range=0..3), Count=Slider(150, range=1..200))
frequency = Slider(0.6, range=0..1)
amplitude = Slider(1, range=1..10)
pi = Pi(Factor=phase)
height = Slider(8, range=0..20)
width = Slider(25, range=0..30)
multiplication = Multiplication(A=series, B=frequency)
addition = Addition(A=multiplication, B=pi)
sin = Sine(Value=addition)
sin_2 = Sine(Value=multiplication)
multiplication_2 = Multiplication(A=sin, B=amplitude)
multiplication_3 = Multiplication(A=sin_2, B=amplitude)
Z = UnitZ(Factor=height)
Y = UnitY(Factor=width)
neg = Negative(Value=multiplication_2)
neg_2 = Negative(Value=multiplication_3)
pt = ConstructPoint(XCoordinate=series, YCoordinate=neg_2, ZCoordinate=multiplication_3)
pt_2 = ConstructPoint(XCoordinate=series, YCoordinate=neg, ZCoordinate=multiplication_2)
pt_3 = ConstructPoint(XCoordinate=series, YCoordinate=multiplication_3, ZCoordinate=multiplication_3)
move = Move(Geometry=pt_2, Motion=Z)  # -> Geometry, Transform
pt_4 = ConstructPoint(XCoordinate=series, YCoordinate=multiplication_2, ZCoordinate=multiplication_2)
move_2 = Move(Geometry=pt_3, Motion=Z)  # -> Geometry, Transform
move_3 = Move(Geometry=move.Geometry, Motion=Y)  # -> Geometry, Transform
move_4 = Move(Geometry=pt, Motion=Y)  # -> Geometry, Transform
number_slider = Slider(0.1, range=0..1)
number_slider_2 = Slider(0.3, range=0..1)
merge = Merge(Data1=graft(pt_4), Data2=graft(move_2.Geometry), Data3=graft(move_3.Geometry), Data4=graft(move_4.Geometry))
neg_3 = Negative(Value=number_slider)
neg_4 = Negative(Value=number_slider_2)
pline = PolyLine(Vertices=merge, Closed=False)

graft = GraftTree(Tree=pt_4, IncludeEmptyLists=True, IncludeNullItems=True)
dom = ConstructDomain(DomainStart=neg_3, DomainEnd=number_slider)
dom_2 = ConstructDomain(DomainStart=neg_4, DomainEnd=number_slider_2)
rectangle = Rectangle(Plane=graft, XSize=dom, YSize=dom_2, Radius=0)  # -> Rectangle, Length
swp1 = Sweep1(Rail=pline, Sections=rectangle.Rectangle, Miter=1)  # disabled
# BReps by sweep (slow)
edges = BrepEdges(Brep=swp1)  # -> Naked, Interior, NonManifold

merge_2 = Merge(Data1=number_slider_2, Data2=neg_4)
planar = Planar(Curve=pline)  # -> Planar, Plane, Deviation
offset_l = OffsetLoose(Curve=pline, Distance=merge_2, Plane=planar.Plane)  # -> simplify(Curve)
deplane = DeconstructPlane(Plane=planar.Plane)  # -> Origin, XAxis, YAxis, ZAxis
lng = ListLength(List=offset_l)
dup = DuplicateData(Data=deplane.ZAxis, Number=lng, Order=True)  # -> simplify(graft(Data))
merge_3 = Merge(Data1=neg_3, Data2=number_slider)
multiplication_4 = Multiplication(A=dup, B=merge_3)
move_5 = Move(Geometry=graft(offset_l), Motion=multiplication_4)  # -> Geometry, Transform
pshift = ShiftPaths(Data=move_5.Geometry, Offset=-1)  # -> simplify(Data)
item = ListItem(List=pshift, Index=0, Wrap=True)  # -> Item, Item1, Item2, Item3
closed = BooleanToggle(True)
merge_4 = Merge(Data1=item.Item, Data2=item.Item1, Data3=item.Item3, Data4=item.Item2)
# Meshes lofts from polylines (fast)
previewlw = CustomPreviewLineweights(Geometry=pshift, Shader=ColourSwatch(SwatchColor=RGB(0, 0, 0)), Absolute=False)

melopy = MeshLoftFromPolylines(P=merge_4, C=closed)  # -> out, M; inputs P: list of Polyline, C: Boolean
# ---------- melopy: C# ----------
    Component.Name = "Mesh Loft From Polylines";
    Component.NickName = "MeLoPy";
    Component.Description = "Makes a mesh loft out of polylines with same number of points";
   
    if (C && !P[0].IsClosed){
      if (P.Count > 2){
        Mesh m1, m0 = new Mesh();
        int pCount,vCount;
        Point3d[] pts0, pts1;
        pCount = P.Count;
        for (int i = 0; i < P.Count; i++){
          pts0 = P[i % pCount].ToArray();
          pts1 = P[(i + 1) % pCount].ToArray();
          vCount = pts0.Length - 1;
          for (int j = 0; j < vCount; j++){
            m1 = new Mesh();
            m1.Vertices.Add(pts0[j]);
            m1.Vertices.Add(pts0[j + 1]);
            m1.Vertices.Add(pts1[j + 1]);
            m1.Vertices.Add(pts1[j]);
            m1.Faces.AddFace(0, 1, 2, 3);
            m0.Append(m1);
          }
        }
        m0.Weld(Math.PI * 0.5);
        m0.Normals.ComputeNormals();
        M = m0;

      }else{
        Print("you need at least 3 polylines");
        M = null;
      }

    }else{
      if (P.Count > 1){
        Mesh m1, m0 = new Mesh();
        int vCount;
        Point3d[] pts0, pts1;
        for (int i = 0; i < P.Count - 1; i++){
          pts0 = P[i].ToArray();
          pts1 = P[i + 1].ToArray();
          vCount = pts0.Length - 1;
          for (int j = 0; j < vCount; j++){
            m1 = new Mesh();
            m1.Vertices.Add(pts0[j]);
            m1.Vertices.Add(pts0[j + 1]);
            m1.Vertices.Add(pts1[j + 1]);
            m1.Vertices.Add(pts1[j]);
            m1.Faces.AddFace(0, 1, 2, 3);
            m0.Append(m1);
          }
        }
        m0.Weld(Math.PI * 0.5);
        m0.Normals.ComputeNormals();
        M = m0;
      }else{
        Print("you need at least 2 polylines");
        M = null;
      }
    }
    //M = p1.ToArray(); // get points of polyline
# ---------- end melopy ----------

previewmat = CustomPreviewMaterials(Geometry=melopy.M, DiffuseColor=RGB(255, 255, 255))
